# Grasshopper definition GroinVaultTillingPaterns.gh (Grasshopper 1.0.7)

tile_thickness = Slider(8, range=0..10)
tile_length = Slider(75, range=30..150)
tile_rotation = Slider(-30, range=-90..90)
tolerance = Slider(3, range=0..3)
tile_width = Slider(37.5, range=0..50)

mesh = Mesh(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)

# ----
# pattern D
number_slider = Slider(0, range=-0.5..0)
python = PythonScript(
    mesh=mesh,
    w_tile=tile_width,
    l_tile=tile_length,
    t_tile=tile_thickness,
    toler_tile=tolerance,
    rot_angle=tile_rotation,
    shift_perc=number_slider)  # -> out, contour_crvs, bottom_face, port, tiles; inputs mesh: Mesh
# ---------- python: Python ----------
import Rhino.Geometry as rg
import math

# gets mid point of a curve
#************************************************
# Function    :     getmidpt
# Programmer  :     Ioannis Mirtsopoulos
# Date        :     2016.06.27
# ***********************************************

def getmidpt(crv):
    ptstart = crv.PointAtStart
    ptend = crv.PointAtEnd
    return rg.Point3d((ptstart[0] + ptend[0])/2, (ptstart[1] + ptend[1])/2, (ptstart[2] + ptend[2])/2)

# moves a line from its mid pt to a new one
#************************************************
# Function    :     moveline
# Programmer  :     Ioannis Mirtsopoulos
# Date        :     2016.06.30
# ***********************************************

def moveline(line, endmidpt):
    line = line.ToNurbsCurve()
    vec_trans = rg.Vector3d(endmidpt - getmidpt(line))
    line.Translate(vec_trans)
    return line

# deconstructs the bounding box of a mesh
#************************************************
# Function    :     deconbbox
# Programmer  :     Ioannis Mirtsopoulos
# Date        :     2016.06.27
# ***********************************************

def deconbbox(mesh):
    # create the bounding box of the mesh
    bbox = mesh.GetBoundingBox(rg.Plane.WorldXY)
    
    # extract the edges of the bounding box
    bboxedges = bbox.GetEdges()
    
    # get the lengths
    bbox_x = bboxedges[0]
    bbox_xlength = bbox_x.Length
    bbox_y = bboxedges[1]
    bbox_ylength = bbox_y.Length
    bbox_z = bboxedges[8]
    bbox_zlength = bbox_z.Length
    
    # get the leftest point of the bounding box // considered to be its starting point
    bbox_start = bbox_x.PointAt(0)
    
    # extract the edge corners
    bbox_edges = bbox.GetCorners()
    
    # get the bottom face of the bounding box
    bbox_bottom = rg.Brep.CreateFromCornerPoints(bbox_edges[0], bbox_edges[1], bbox_edges[2], bbox_edges[3], 0.01)
    
    # define the longest edge as the barrel's direction
    if bbox_xlength >= bbox_ylength: line_dir = bbox_x
    else: line_dir = bbox_y
    
    # create a vector for the long edge direction
    start = line_dir.PointAt(0)
    end = line_dir.PointAt(1)
    vec_dir = rg.Vector3d(end-start)
    vec_dir.Unitize()
    
    # create the diagonal of the bounding box
    diagon = rg.Line(bbox_x.PointAt(0), bbox_y.PointAt(1))
    diagonal = rg.LineCurve(diagon) # only created to get the mid point
    vec_diagon = rg.Vector3d(diagon.PointAt(1) - diagon.PointAt(0))
    vec_diagon.Unitize()
    
    # get the center of the base face
    center = getmidpt(diagonal)
    
    #rotate the longest edge around the center of the bounding box and parallelize it to the longest edge
    angle = rg.Vector3d.VectorAngle(vec_dir, vec_diagon)
    diagonal.Rotate(-angle, rg.Vector3d.ZAxis, center)
    mid_line = diagonal
    
    # 0 returns x edge as line
    # 1 returns y edge as line
    # 2 returns z edge as line
    # 3 returns x edge's length
    # 4 returns y edge's length
    # 5 returns z edge's length
    # 6 returns the longest edge of the bounding box
    # 7 returns the longest's edge direction as a unitized vector
    # 8 returns the diagonal on the WorldXY as a line
    # 9 returns the mid point of the above defined diagonal (center)
    # 10 returns the diagon's edge direction as a unitized vector
    # 11 returns the longest edge as curve passing through the area's center (mid_line)
    # 12 returns the starting box of the bounding box (the leftest point)
    # 13 returns the bottom face of the bounding box 
    return bbox_x, bbox_y, bbox_z, bbox_xlength, bbox_ylength, bbox_zlength, line_dir, vec_dir, diagon, center, vec_diagon, mid_line, bbox_start, bbox_bottom

# shift list
#************************************************
# Function    :     shiftlist
# Programmer  :     Ioannis Mirtsopoulos
# Date        :     2016.06.27
# ***********************************************

def shift(list, k, direction):
    if direction == "right":
        k = len(list) - k
    right = list[k:]
    left = list[:k]
    return right + left

# extends a curve's end by a length
#************************************************
# Function    :     extendcrvend
# Programmer  :     Ioannis Mirtsopoulos
# Date        :     2016.06.30
# ***********************************************

def extendcrvend(curve, length):
    new_curve = curve.Extend(rg.CurveEnd.End, length, rg.CurveExtensionStyle.Line)
    return new_curve

# splits a curve in two
#************************************************
# Function    :     splitcrvin2
# Programmer  :     Ioannis Mirtsopoulos
# Date        :     2016.06.30
# ***********************************************

def splitcrvin2(curve):
    split_curve_array = curve.Split((curve.LengthParameter(curve.GetLength()/2))[1])
    return split_curve_array

# extends a curve both sides by a length
#************************************************
# Function    :     extendcrv
# Programmer  :     Ioannis Mirtsopoulos
# Date        :     2016.06.30
# ***********************************************

def extendcrvboth(curve, length):
    new_curve = curve.Extend(rg.CurveEnd.Both, length, rg.CurveExtensionStyle.Line)
    return new_curve

# extends a curve's end side by a length
#************************************************
# Function    :     extendcrv
# Programmer  :     Ioannis Mirtsopoulos
# Date        :     2016.06.30
# ***********************************************

def extendcrvend(curve, length):
    new_curve = curve.Extend(rg.CurveEnd.End, length, rg.CurveExtensionStyle.Line)
    return new_curve

# mix two arrays respectively
#************************************************
# Function    :     mixlistresp
# Programmer  :     Ioannis Mirtsopoulos
# Date        :     2016.07.02
# ***********************************************

def mixlistresp(list1, list2):
    newlist = []
    for l1, l2 in zip(list1, list2):
        newlist.append(l1)
        newlist.append(l2)
    return newlist

# get the segments out of a splitted curve and
# the highest point of it
#************************************************
# Function    :     splitcrvin2advanced
# Programmer  :     Ioannis Mirtsopoulos
# Date        :     2016.07.02
# ***********************************************

def splitcrvin2advanced (crv, tile_length, tile_tolerance):
    # extend the curve both sides
    crv_ext = extendcrvboth(crv, (tile_length + tile_tolerance)/2)
    
    # split the curve in two
    crv_split = splitcrvin2(crv_ext)
    split_1 = crv_split[0]
    split_1.Reverse()     # DivideByLength starts the division from the end of the curve, so I reverse the curve!!!!
    split_2 = crv_split[1]
    
    # get the highest point of the contour curve
    top_pt = split_1.PointAtNormalizedLength(0)
    return top_pt, split_1, split_2

# get the params and points of a divided curve
#************************************************
# Function    :     paramsptsdividecrv
# Programmer  :     Ioannis Mirtsopoulos
# Date        :     2016.07.02
# ***********************************************

def paramsptsdividecrv(curve, division_length):
    
    # divide curve
    params = curve.DivideByLength(division_length, False)
    pts = []
    for param in params:
        pt = curve.PointAt(param)
        pts.append(pt)
    return params, pts

# generate a tile given a point, its param and the mesh
#************************************************
# Function    :     gentile
# Programmer  :     Ioannis Mirtsopoulos
# Date        :     2016.07.02
# ***********************************************

def gentile (pt, pt_param, crv, mesh, width, length, thickness):
    # VERY IMPORTANT // find the 3d point's closest mesh point
    mesh_pt = mesh.ClosestMeshPoint(pt, 0)
    # store the Mesh point generated before in a mesh
    norm = mesh.NormalAt(mesh_pt)
    # define a plane (in-between layer of the tiles)
    tangent = crv.TangentAt(pt_param)
    cp = rg.Plane(pt, norm, tangent)
    cp.Rotate(math.radians(90), cp.YAxis, pt)
    # generate a tile
    tile = rg.Box(cp, rg.Interval(-width/2, width/2),rg.Interval(-length/2, length/2),rg.Interval(-thickness/2, thickness/2))
    return norm, cp, tile

#################################################
##########        S T A R T        ##############
#################################################

# get the longest edge of the bounding box, passing throught the area's center
direction = deconbbox(mesh)[11]
direction.Rotate(math.radians(rot_angle), rg.Vector3d.ZAxis, deconbbox(mesh)[9])

# divide the curve and get the params to evaluate
contour_params = direction.DivideByLength((w_tile + toler_tile)/2, False)
contour_params = contour_params[1::2]

perp_frames = []
# create the points of the subdivision on the diagonal and perpendicular frames on them
for param in contour_params:
    plane = rg.Plane(direction.PointAt(param), rg.Vector3d(direction.PointAt(1) - direction.PointAt(0)))
    perp_frames.append(plane)

contour_crvs = []
# create the contour curves
for frame in perp_frames:
    curve = rg.Mesh.CreateContourCurves(mesh, frame)
    
    # DivideByLength starts the division from the end of the curve
    # so I reverse the curve!!!! (optional...)
    if len(curve) > 0:
        curve[0].Reverse()
        contour_crvs.append(curve[0])

bottom_face = deconbbox(mesh)[13]

#############################################################
# VERY IMPORTANT in order to get the normals of the mesh
# otherwise i will always be getting vertical vectors (0,0,1)
#############################################################
mesh.Normals.ComputeNormals()

# get the middle curve and separate the others
if len(contour_crvs)%2 == 1:
    mid_crv = contour_crvs[int(len(contour_crvs)/2) - 1]
elif len(contour_crvs)%2 == 0:
    len1 = rg.Curve.GetLength(contour_crvs[int(len(contour_crvs)/2) - 1])
    len2 = rg.Curve.GetLength(contour_crvs[int(len(contour_crvs)/2)])
    if len1 >= len2:
        mid_crv = contour_crvs[int(len(contour_crvs)/2) - 1]
    elif len1 < len2:
        mid_crv = contour_crvs[int(len(contour_crvs)/2)]

# id is the index of the middle curve for the general array of contour curves
id = contour_crvs.index(mid_crv)
contour_crvs_A = contour_crvs[:id]
contour_crvs_A = contour_crvs_A[::-1]
contour_crvs_B = contour_crvs[id:]
contour_crvs_B = contour_crvs_B[1:]
contour_mid = mid_crv


top_pt = splitcrvin2advanced(mid_crv, l_tile, toler_tile)[0]
top_pt_param = 0
crv_A = splitcrvin2advanced(mid_crv, l_tile, toler_tile)[1]
crv_B = splitcrvin2advanced(mid_crv, l_tile, toler_tile)[2]
params_A = paramsptsdividecrv(crv_A,(l_tile + toler_tile)/2)[0]
# keep only the needed params
params_A = params_A[1::2]
# the list needs to be reverse because division starts from the end
params_A = params_A[::-1]
params_B = paramsptsdividecrv(crv_B,(l_tile + toler_tile)/2)[0]
# keep only the needed params
params_B = params_B[1::2]
# the list needs to be reverse because division starts from the end
params_B = params_B[::-1]
pts_A = paramsptsdividecrv(crv_A,(l_tile + toler_tile)/2)[1]
pts_A = pts_A[1::2]
# the list needs to be reverse because division starts from the end
pts_A.reverse()
pts_B = paramsptsdividecrv(crv_B,(l_tile + toler_tile)/2)[1]
pts_B = pts_B[1::2]
# the list needs to be reverse because division starts from the end
pts_B.reverse()

############################################################
# IMPORTANT: it assumed the length of the two lists is equal,
# otherwise it will not work
############################################################
tiles = []
for i in range(len(pts_A)):
    tile_A = gentile(pts_A[i], params_A[i], mid_crv, mesh, w_tile, l_tile, t_tile)[2]
    tile_B = gentile(pts_B[i], params_B[i], mid_crv, mesh, w_tile, l_tile, t_tile)[2]
    tiles.append(tile_A)
    tiles.append(tile_B)
tile_top = gentile(top_pt, top_pt_param, crv_A, mesh, w_tile, l_tile, t_tile)[2]
tiles.append(tile_top)

start_pts = []
end_pts = []
closest_pts = []
shifted_pts = []
splits_1 = []
splits_2 = []
pts_A_new = []
pts_B_new = []
pts_C_new = []
crv_params_pts = []
shift_pt = top_pt
dir_factor = 1
crvs_ext = []
for crv in contour_crvs_A:
    crv.Reverse()
    crv_ext = extendcrvboth(crv, (l_tile + toler_tile)/2)
    crvs_ext.append(crv_ext)
    
    # get start param and point
    start_param = crv.LengthParameter(0)[1]
    start_pts.append(crv.PointAt(start_param))

    # get end param and point
    end_param = crv.LengthParameter(crv.GetLength())[1]
    end_pts.append(crv.PointAt(end_param))

    # get the closest point's param and point
    closest_param = crv.ClosestPoint(shift_pt)[1]
    closest_pt = crv.PointAt(closest_param)
    closest_pts.append(closest_pt)
        
    closest_param_len = crv.GetLength(rg.Interval(start_param, closest_param)) # gives me the length of the param from the start of the curve
    
    if dir_factor == 1:
        shift_len = closest_param_len + shift_perc*l_tile*dir_factor
    elif dir_factor == -1:
        shift_len = closest_param_len + (1-shift_perc)*l_tile*dir_factor
    
    #################################################################
    # ATTENTION: if it is decided to be debugged extra attention here
    #################################################################
    
    if shift_len <= 0:
        if crv.GetLength() >= (l_tile + toler_tile):
            while shift_len <= 0:
                shift_len += (l_tile + toler_tile)
        else:
            shift_len = crv.GetLength()/2
    shift_pt = crv.PointAtLength(shift_len)
    shift_param = crv.LengthParameter(shift_len)[1]
    shifted_pts.append(shift_pt)

    #####################################################
    # CHECK the distance between the param and the edges
    #####################################################
    if dir_factor == 1:
        check_length = crv.GetLength(rg.Interval(shift_param, end_param))
        if check_length < 2*l_tile:
            dir_factor = -1
    elif dir_factor == -1:
        check_length = crv.GetLength(rg.Interval(start_param, shift_param))
        if check_length < 2*l_tile:
            dir_factor = 1

    split_crv_array = crv.Split(shift_param)
    split_1 = split_crv_array[0]
    split_1.Reverse()
    split_1 = extendcrvend(split_1, (l_tile + toler_tile)/2)
    split_2 = extendcrvend(split_crv_array[1], (l_tile + toler_tile)/2)
    parameters_A_new_miss = split_1.DivideByLength((l_tile + toler_tile)/2, False)
    parameters_B_new_miss = split_2.DivideByLength((l_tile + toler_tile)/2, False)
    parameters_A_new_miss = parameters_A_new_miss[1::2]
    parameters_B_new_miss = parameters_B_new_miss[1::2]
    
    parameters_A_new = []
    parameters_A_new.append(split_1.ClosestPoint(shift_pt)[1])
    for p in parameters_A_new_miss:
        parameters_A_new.append(p)
    
    parameters_B_new = []
    for p in parameters_B_new_miss:
        parameters_B_new.append(p)
    
    parameters_A_new = parameters_A_new[::-1]
    parameters_B_new = parameters_B_new[::-1]
    
    splits_1.append(split_1)
    splits_2.append(split_2)
    
    #####################################################################################
    # IMPORTANT: all the params saved in seq array refer to split_1 and split_2
    # so the parameters of their closest points on the contour_crvs_A and B will be taken
    #####################################################################################
    crv_params = []

    if len(parameters_A_new) == len(parameters_B_new):
        for i, j in zip(parameters_A_new, parameters_B_new):
            pt_A = split_1.PointAt(i)
            pts_A_new.append(pt_A)
            
            pt_B = split_2.PointAt(j)
            pts_B_new.append(pt_B)
            
            crv_params.append(crv_ext.ClosestPoint(pt_A)[1])
            crv_params.append(crv_ext.ClosestPoint(pt_B)[1])
    elif len(parameters_A_new) > len(parameters_B_new):
        parameters_A_new_temp = parameters_A_new[:len(parameters_B_new)]
        for i, j in zip(parameters_A_new_temp, parameters_B_new):
            pt_A = split_1.PointAt(i)
            pts_A_new.append(pt_A)
            
            pt_B = split_2.PointAt(j)
            pts_B_new.append(pt_B)
            
            crv_params.append(crv_ext.ClosestPoint(pt_A)[1])
            crv_params.append(crv_ext.ClosestPoint(pt_B)[1])
        
        parameters_C = parameters_A_new[len(parameters_B_new):]
        
        # split the list
        mod = len(parameters_C)%2
        half = int(len(parameters_C)/2)
        params_1 = parameters_C[:(half + mod)]
        params_2 = parameters_C[(half + mod):]
        params_2 = params_2[::-1]
        
        for k in range(half) :
            pt_C = split_1.PointAt(params_1[k])
            pts_C_new.append(pt_C)
            crv_params.append(crv_ext.ClosestPoint(pt_C)[1])
            pt_D = split_1.PointAt(params_2[k])
            pts_C_new.append(pt_D)
            crv_params.append(crv_ext.ClosestPoint(pt_D)[1])
        
        if mod == 1: # len(params 1) > len(params_2)
            pt_C = split_1.PointAt(params_1[half])
            pts_C_new.append(pt_C)
            crv_params.append(crv_ext.ClosestPoint(pt_C)[1])
    
    elif len (parameters_A_new) < len(parameters_B_new):
        parameters_B_new_temp = parameters_B_new[:len(parameters_A_new)]
        for i, j in zip(parameters_A_new, parameters_B_new_temp):
            pt_A = split_1.PointAt(i)
            pts_A_new.append(pt_A)
            
            pt_B = split_2.PointAt(j)
            pts_B_new.append(pt_B)
            
            crv_params.append(crv_ext.ClosestPoint(pt_A)[1])
            crv_params.append(crv_ext.ClosestPoint(pt_B)[1])
        
        parameters_C = parameters_B_new[len(parameters_A_new):]
        
        # split the list
        mod = len(parameters_C)%2
        half = int(len(parameters_C)/2)
        params_1 = parameters_C[:(half + mod)]
        params_2 = parameters_C[(half + mod):]
        params_2 = params_2[::-1]
        
        for k in range(half) :
            pt_C = split_2.PointAt(params_1[k])
            pts_C_new.append(pt_C)
            crv_params.append(crv_ext.ClosestPoint(pt_C)[1])
            pt_D = split_2.PointAt(params_2[k])
            pts_C_new.append(pt_D)
            crv_params.append(crv_ext.ClosestPoint(pt_D)[1])

        if mod == 1: # len(params 1) < len(params_2)
            pt_C = split_2.PointAt(params_1[half])
            pts_C_new.append(pt_C)
            crv_params.append(crv_ext.ClosestPoint(pt_C)[1])
        
    seq = []
    #########################################################################
    # CHECK: if parameters == None it means it is not possible to divide the
    # contour line as its length is smaller than the tile's length
    #########################################################################
    if crv_params != None:
        for param in crv_params:
            seq.append(param)
    
    # add a point at the params
    for param in seq:
    #for param in crv_params:
        pt = crv_ext.PointAt(param)
        crv_params_pts.append(pt)
        
        # VERY IMPORTANT // find the 3d point's closest mesh point
        mesh_pt = mesh.ClosestMeshPoint(pt, 0)
        
        # store the Mesh point generated before in a mesh
        normal = mesh.NormalAt(mesh_pt)
        #mesh_norms.append(normal)
        
        # define a plane (in-between layer of the tiles)
        tangent = crv_ext.TangentAt(param)
        cp = rg.Plane(pt, normal, tangent)
        cp.Rotate(math.radians(90), cp.YAxis, pt)
        #planes.append(cp)
        
        # generate a tile
        tile = rg.Box(cp, rg.Interval(-w_tile/2, w_tile/2),rg.Interval(-l_tile/2, l_tile/2),rg.Interval(-t_tile/2, t_tile/2))
        tiles.append(tile)

start_pts_B = []
end_pts_B = []
closest_pts_B = []
shifted_pts_B = []
splits_1B = []
splits_2B = []
pts_A_newB = []
pts_B_newB = []
pts_C_newB = []
crv_params_ptsB = []
shift_pt = top_pt
dir_factor_B = 1
crvs_ext_B = []
for crv in contour_crvs_B:
    #crv.Reverse()
    crv_ext = extendcrvboth(crv, (l_tile + toler_tile)/2)
    #crv = crv_ext
    crvs_ext_B.append(crv_ext)
    
    # get start param and point
    start_param = crv.LengthParameter(0)[1]
    start_pts_B.append(crv.PointAt(start_param))
    
    # get end param and point
    end_param = crv.LengthParameter(crv.GetLength())[1]
    end_pts_B.append(crv.PointAt(end_param))
    
    # get the closest point's param and point
    closest_param = crv.ClosestPoint(shift_pt)[1]
    closest_pt = crv.PointAt(closest_param)
    closest_pts_B.append(closest_pt)
    
    closest_param_len = crv.GetLength(rg.Interval(start_param, closest_param)) # gives me the length of the param from the start of the curve
    
    if dir_factor_B == 1:
        shift_len = closest_param_len + shift_perc*l_tile*dir_factor_B
    elif dir_factor_B == -1:
        shift_len = closest_param_len + (1-shift_perc)*l_tile*dir_factor_B
    
    #################################################################
    # ATTENTION: if it is decided to be debugged extra attention here
    #################################################################
    
    if shift_len <= 0:
        if crv.GetLength() >= (l_tile + toler_tile):
            while shift_len <= 0:
                shift_len += (l_tile + toler_tile)
        else:
            shift_len = crv.GetLength()/2
    shift_pt = crv.PointAtLength(shift_len)
    shift_param = crv.LengthParameter(shift_len)[1]
    shifted_pts_B.append(shift_pt)
    
    #####################################################
    # CHECK the distance between the param and the edges
    #####################################################
    if dir_factor_B == 1:
        check_length = crv.GetLength(rg.Interval(shift_param, end_param))
        if check_length < 2*l_tile:
            dir_factor_B = -1
    elif dir_factor_B == -1:
        check_length = crv.GetLength(rg.Interval(start_param, shift_param))
        if check_length < 2*l_tile:
            dir_factor_B = 1
            
    split_crv_array = crv.Split(shift_param)
    split_1 = split_crv_array[0]
    split_1.Reverse()
    split_1 = extendcrvend(split_1, (l_tile + toler_tile)/2)
    split_2 = extendcrvend(split_crv_array[1], (l_tile + toler_tile)/2)
    parameters_A_new_miss = split_1.DivideByLength((l_tile + toler_tile)/2, False)
    parameters_B_new_miss = split_2.DivideByLength((l_tile + toler_tile)/2, False)
    parameters_A_new_miss = parameters_A_new_miss[1::2]
    parameters_B_new_miss = parameters_B_new_miss[1::2]
    
    parameters_A_new = []
    parameters_A_new.append(split_1.ClosestPoint(shift_pt)[1])
    for p in parameters_A_new_miss:
        parameters_A_new.append(p)
    
    parameters_B_new = []
    for p in parameters_B_new_miss:
        parameters_B_new.append(p)
    
    parameters_A_new = parameters_A_new[::-1]
    parameters_B_new = parameters_B_new[::-1]
    
    splits_1B.append(split_1)
    splits_2B.append(split_2)
    
    #####################################################################################
    # IMPORTANT: all the params saved in seq array refer to split_1 and split_2
    # so the parameters of their closest points on the contour_crvs_A and B will be taken
    #####################################################################################
    crv_params = []

    if len(parameters_A_new) == len(parameters_B_new):
        for i, j in zip(parameters_A_new, parameters_B_new):
            pt_A = split_1.PointAt(i)
            pts_A_newB.append(pt_A)
            
            pt_B = split_2.PointAt(j)
            pts_B_newB.append(pt_B)
            
            crv_params.append(crv_ext.ClosestPoint(pt_A)[1])
            crv_params.append(crv_ext.ClosestPoint(pt_B)[1])
    elif len(parameters_A_new) > len(parameters_B_new):
        parameters_A_new_temp = parameters_A_new[:len(parameters_B_new)]
        for i, j in zip(parameters_A_new_temp, parameters_B_new):
            pt_A = split_1.PointAt(i)
            pts_A_newB.append(pt_A)
            
            pt_B = split_2.PointAt(j)
            pts_B_newB.append(pt_B)
            
            crv_params.append(crv_ext.ClosestPoint(pt_A)[1])
            crv_params.append(crv_ext.ClosestPoint(pt_B)[1])
        
        parameters_C = parameters_A_new[len(parameters_B_new):]
        
        # split the list
        mod = len(parameters_C)%2
        half = int(len(parameters_C)/2)
        params_1 = parameters_C[:(half + mod)]
        params_2 = parameters_C[(half + mod):]
        params_2 = params_2[::-1]
        
        for k in range(half) :
            pt_C = split_1.PointAt(params_1[k])
            pts_C_newB.append(pt_C)
            crv_params.append(crv_ext.ClosestPoint(pt_C)[1])
            pt_D = split_1.PointAt(params_2[k])
            pts_C_newB.append(pt_D)
            crv_params.append(crv_ext.ClosestPoint(pt_D)[1])
        
        if mod == 1: # len(params 1) > len(params_2)
            pt_C = split_1.PointAt(params_1[half])
            pts_C_newB.append(pt_C)
            crv_params.append(crv_ext.ClosestPoint(pt_C)[1])
    
    elif len (parameters_A_new) < len(parameters_B_new):
        parameters_B_new_temp = parameters_B_new[:len(parameters_A_new)]
        for i, j in zip(parameters_A_new, parameters_B_new_temp):
            pt_A = split_1.PointAt(i)
            pts_A_newB.append(pt_A)
            
            pt_B = split_2.PointAt(j)
            pts_B_newB.append(pt_B)
            
            crv_params.append(crv_ext.ClosestPoint(pt_A)[1])
            crv_params.append(crv_ext.ClosestPoint(pt_B)[1])
        
        parameters_C = parameters_B_new[len(parameters_A_new):]
        
        # split the list
        mod = len(parameters_C)%2
        half = int(len(parameters_C)/2)
        params_1 = parameters_C[:(half + mod)]
        params_2 = parameters_C[(half + mod):]
        params_2 = params_2[::-1]
        
        for k in range(half) :
            pt_C = split_2.PointAt(params_1[k])
            pts_C_newB.append(pt_C)
            crv_params.append(crv_ext.ClosestPoint(pt_C)[1])
            pt_D = split_2.PointAt(params_2[k])
            pts_C_newB.append(pt_D)
            crv_params.append(crv_ext.ClosestPoint(pt_D)[1])

        if mod == 1: # len(params 1) < len(params_2)
            pt_C = split_2.PointAt(params_1[half])
            pts_C_newB.append(pt_C)
            crv_params.append(crv_ext.ClosestPoint(pt_C)[1])
            
    seq = []
    #########################################################################
    # CHECK: if parameters == None it means it is not possible to divide the
    # contour line as its length is smaller than the tile's length
    #########################################################################
    if crv_params != None:
        for param in crv_params:
            seq.append(param)
    
    # add a point at the params
    for param in seq:
    #for param in crv_params:
        pt = crv_ext.PointAt(param)
        crv_params_ptsB.append(pt)
        
        # VERY IMPORTANT // find the 3d point's closest mesh point
        mesh_pt = mesh.ClosestMeshPoint(pt, 0)
        
        # store the Mesh point generated before in a mesh
        normal = mesh.NormalAt(mesh_pt)
        #mesh_norms.append(normal)
        
        # define a plane (in-between layer of the tiles)
        tangent = crv_ext.TangentAt(param)
        cp = rg.Plane(pt, normal, tangent)
        cp.Rotate(math.radians(90), cp.YAxis, pt)
        #planes.append(cp)
        
        # generate a tile
        tile = rg.Box(cp, rg.Interval(-w_tile/2, w_tile/2),rg.Interval(-l_tile/2, l_tile/2),rg.Interval(-t_tile/2, t_tile/2))
        tiles.append(tile)
# ---------- end python ----------
crv = Curve(python.contour_crvs)
srf = Surface(python.bottom_face)
box = Box(python.tiles)

# ----
# pattern B (respectively = False)
# pattern C (respectively = True)
toggle = BooleanToggle(False)
python_2 = PythonScript(
    respectively=toggle,
    mesh=mesh,
    w_tile=tile_width,
    l_tile=tile_length,
    t_tile=tile_thickness,
    toler_tile=tolerance,
    rot_angle=tile_rotation)  # -> out, contours, bottom_face, port, pts, mesh_norms, planes, tiles; inputs respectively: Boolean, mesh: Mesh
# ---------- python_2: Python ----------
import Rhino.Geometry as rg
import math

# gets Mid Point of a Curve
#************************************************
# Function    :     getmidpt
# Programmer  :     Ioannis Mirtsopoulos
# Date        :     2016.06.27
# ***********************************************

def getmidpt(crv):
    ptstart = crv.PointAtStart
    ptend = crv.PointAtEnd
    return rg.Point3d((ptstart[0] + ptend[0])/2, (ptstart[1] + ptend[1])/2, (ptstart[2] + ptend[2])/2)

# moves a line from its mid pt to a new one
#************************************************
# Function    :     moveline
# Programmer  :     Ioannis Mirtsopoulos
# Date        :     2016.06.30
# ***********************************************

def moveline(line, endmidpt):
    line = line.ToNurbsCurve()
    vec_trans = rg.Vector3d(endmidpt - getmidpt(line))
    line.Translate(vec_trans)
    return line

# deconstructs the bounding box of a mesh
#************************************************
# Function    :     deconbbox
# Programmer  :     Ioannis Mirtsopoulos
# Date        :     2016.06.27
# ***********************************************

def deconbbox(mesh):
    # create the bounding box of the mesh
    bbox = mesh.GetBoundingBox(rg.Plane.WorldXY)
    
    # extract the edges of the bounding box
    bboxedges = bbox.GetEdges()
    
    # get the lengths
    bbox_x = bboxedges[0]
    bbox_xlength = bbox_x.Length
    bbox_y = bboxedges[1]
    bbox_ylength = bbox_y.Length
    bbox_z = bboxedges[8]
    bbox_zlength = bbox_z.Length
    
    # get the leftest point of the bounding box // considered to be its starting point
    bbox_start = bbox_x.PointAt(0)
    
    # extract the edge corners
    bbox_edges = bbox.GetCorners()
    
    # get the bottom face of the bounding box
    bbox_bottom = rg.Brep.CreateFromCornerPoints(bbox_edges[0], bbox_edges[1], bbox_edges[2], bbox_edges[3], 0.01)
    
    # define the longest edge as the barrel's direction
    if bbox_xlength >= bbox_ylength: line_dir = bbox_x
    else: line_dir = bbox_y
    
    # create a vector for the long edge direction
    start = line_dir.PointAt(0)
    end = line_dir.PointAt(1)
    vec_dir = rg.Vector3d(end-start)
    vec_dir.Unitize()
    
    # create the diagonal of the bounding box
    diagon = rg.Line(bbox_x.PointAt(0), bbox_y.PointAt(1))
    diagonal = rg.LineCurve(diagon) # only created to get the mid point
    vec_diagon = rg.Vector3d(diagon.PointAt(1) - diagon.PointAt(0))
    vec_diagon.Unitize()
    
    # get the center of the base face
    center = getmidpt(diagonal)
    
    #rotate the longest edge around the center of the bounding box and parallelize it to the longest edge
    angle = rg.Vector3d.VectorAngle(vec_dir, vec_diagon)
    diagonal.Rotate(-angle, rg.Vector3d.ZAxis, center)
    mid_line = diagonal
    
    # 0 returns x edge as line
    # 1 returns y edge as line
    # 2 returns z edge as line
    # 3 returns x edge's length
    # 4 returns y edge's length
    # 5 returns z edge's length
    # 6 returns the longest edge of the bounding box
    # 7 returns the longest's edge direction as a unitized vector
    # 8 returns the diagonal on the WorldXY as a line
    # 9 returns the mid point of the above defined diagonal (center)
    # 10 returns the diagon's edge direction as a unitized vector
    # 11 returns the longest edge as curve passing through the area's center (mid_line)
    # 12 returns the starting box of the bounding box (the leftest point)
    # 13 returns the bottom face of the bounding box
    return bbox_x, bbox_y, bbox_z, bbox_xlength, bbox_ylength, bbox_zlength, line_dir, vec_dir, diagon, center, vec_diagon, mid_line, bbox_start, bbox_bottom

# shift list
#************************************************
# Function    :     shiftlist
# Programmer  :     Ioannis Mirtsopoulos
# Date        :     2016.06.27
# ***********************************************

def shift(list, k, direction):
    if direction == "right":
        k = len(list) - k
    right = list[k:]
    left = list[:k]
    return right + left

# extends a curve's end by a length
#************************************************
# Function    :     extendcrvend
# Programmer  :     Ioannis Mirtsopoulos
# Date        :     2016.06.30
# ***********************************************

def extendcrvend(curve, length):
    new_curve = curve.Extend(rg.CurveEnd.End, length, rg.CurveExtensionStyle.Line)
    return new_curve

# splits a curve in two
#************************************************
# Function    :     splitcrvin2
# Programmer  :     Ioannis Mirtsopoulos
# Date        :     2016.06.30
# ***********************************************

def splitcrvin2(curve):
    split_curve_array = curve.Split((crv_ext.LengthParameter(crv_ext.GetLength()/2))[1])
    return split_curve_array

# mix two arrays respectively
#************************************************
# Function    :     mixlistresp
# Programmer  :     Ioannis Mirtsopoulos
# Date        :     2016.0.02
# ***********************************************

def mixlistresp(list1, list2):
    newlist = []
    for l1, l2 in zip(list1, list2):
        newlist.append(l1)
        newlist.append(l2)
    return newlist


#################################################
#################################################
#######           S T A R T        ##############
#################################################
#################################################

# get the longest edge of the bounding box, passing throught the area's center
direction = deconbbox(mesh)[11]
direction.Rotate(math.radians(rot_angle), rg.Vector3d.ZAxis, deconbbox(mesh)[9])

# divide the curve and get the params to evaluate
contour_params = direction.DivideByLength((w_tile + toler_tile)/2, False)
contour_params = contour_params[1::2]

contour_pts = []
perp_frames = []

# create the points of the subdivision on the diagonal and perpendicular frames on them
for param in contour_params:
    contour_pts.append(direction.PointAt(param))
    plane = rg.Plane(direction.PointAt(param), rg.Vector3d(direction.PointAt(1) - direction.PointAt(0)))
    #plane.Rotate(math.radians(rot_angle), plane.YAxis, direction.PointAt(param))
    perp_frames.append(plane)

contour_crvs = []

# create the contour curves
for frame in perp_frames:
    curve = rg.Mesh.CreateContourCurves(mesh, frame)
    
    # DivideByLength starts the division from the end of the curve
    # so I reverse the curve!!!! (optional...)
    if len(curve) > 0:
        curve[0].Reverse()
        contour_crvs.append(curve[0])

#############################################################
# VERY IMPORTANT in order to get the normals of the mesh
# otherwise i will always be getting vertical vectors (0,0,1)
#############################################################
mesh.Normals.ComputeNormals()

new_params = []
tile_pts = []
tile_norms = []
mesh_norms = []
planes = []
tiles = []

# take the odd curves
contour_crvs_A = contour_crvs[0::2]
# take the even curves
contour_crvs_B = contour_crvs[1::2]

#############################################################
# VERY IMPORTANT in order to make the contours always
# touching the edges RESPECTIVELY. Even crvs are reversed.
# If respectively is TRUE then that is the case...........
#############################################################
if respectively:
    for crv in contour_crvs_B:
        crv.Reverse()
#############################################################
#############################################################

contours = mixlistresp(contour_crvs_A, contour_crvs_B)

crvs_ext = []
pts = []
mesh_norms = []
planes = []
tiles = []
bottom_face = deconbbox(mesh)[13]

for crv in contours:
    #########################################################################################################
    # VERY IMPORTANT CHECK to ensure that for contours starting from YAxis segments the principle still works
    # CHECK: what is the angle between the direction and the vec defined by the bbox start and the crv start
    #########################################################################################################
    
    test_point = crv.PointAtNormalizedLength(0)
    projected = rg.Brep.ClosestPoint(bottom_face, test_point)
    vec = rg.Vector3d(projected - deconbbox(mesh)[12])
    angle = math.degrees(rg.Vector3d.VectorAngle(vec, deconbbox(mesh)[7], rg.Plane.WorldXY))

    ####################################################################
    # based on the above check, if the agnel is 0, rot_angle is fine.
    # IF NOT, the angle has to be changed from rot_angle to 90-rot_angle
    ####################################################################
    if angle != 0:
        rot_angle_f = 90 - abs(rot_angle)
    else:
        rot_angle_f = rot_angle

    # extend the curve 's end
    crv_ext = extendcrvend(crv, (l_tile/2 + toler_tile))
    
    # store the extended curves
    crvs_ext.append(crv_ext)
    
    #########################################################################
    # CHECK: if plaster_offset < toler_tile/2 ----> the first tile is trimmed
    # BUT, the plaster offset is the one is meant to be 
    #########################################################################
    plaster_offset = toler_tile*math.cos(math.radians(rot_angle_f))/2
    overall_offset = toler_tile/2
    if plaster_offset < toler_tile/2:
        overall_offset = (((w_tile*math.tan(math.radians(abs(rot_angle_f))))/2) - toler_tile/2)%l_tile
    
    split_crv_array = crv_ext.Split(crv_ext.LengthParameter(overall_offset)[1])
    split_1 = split_crv_array[0] # this is not needed, it is just a shift of the crv's start point
    
    if plaster_offset < toler_tile/2:
        split_1.Reverse()
        split_1 = extendcrvend(split_1, (l_tile + toler_tile)/2) # this seg is extended to host ONE trimmed tile
        # first param of the curve, belongs to the first trimmed tile
        f_param = split_1.LengthParameter((l_tile + toler_tile)/2)[1]
    split_2 = split_crv_array[1]
    
    # divide the curves
    params = split_2.DivideByLength((l_tile + toler_tile)/2, False)
    
    seq = []
    #########################################################################
    # CHECK: if params == None it means it is not possible to divide the
    # contour line as its length is smaller than the tile's length
    #########################################################################
    if params != None:
        # keep only the needed params
        params = params[0::2]
        
        # split the list
        mod = len(params)%2
        half = int(len(params)/2)
        params_1 = params[:(half + mod)]
        params_2 = params[(half + mod):]
        params_2 = params_2[::-1]
        
        # insert as a first tile's param the trimmed one
        if f_param != None:
            seq.append(f_param)
            for i in range(half):
                seq.append(params_2[i])
                seq.append(params_1[i])
        else:
            for i in range(half):
                seq.append(params_1[i])
                seq.append(params_2[i])
        
        if mod != 0: seq.append(params_1[half])
    else: # only refers to the case that params = None
        seq.append(crv.LengthParameter(crv.GetLength()/2)[1])
    
    # add a point at the params
    for param in seq:
        if len(seq) == 1:   # only refers to the case that params = None
            pt = crv.PointAt(param)
        elif seq.index(param) == 0 and f_param != None:
            pt = split_1.PointAt(param)
        else:
            pt = split_2.PointAt(param)
        pts.append(pt)
    
        # VERY IMPORTANT // find the 3d point's closest mesh point
        mesh_pt = mesh.ClosestMeshPoint(pt, 0)
        
        # store the Mesh point generated before in a mesh
        normal = mesh.NormalAt(mesh_pt)
        mesh_norms.append(normal)
        
        # define a plane (in-between layer of the tiles)
        tangent = crv.TangentAt(param)
        cp = rg.Plane(pt, normal, tangent)
        cp.Rotate(math.radians(90), cp.YAxis, pt)
        planes.append(cp)
        
        # generate a tile
        tile = rg.Box(cp, rg.Interval(-w_tile/2, w_tile/2),rg.Interval(-l_tile/2, l_tile/2),rg.Interval(-t_tile/2, t_tile/2))
        tiles.append(tile)
# ---------- end python_2 ----------
crv_2 = Curve(python_2.contours)
srf_2 = Surface(python_2.bottom_face)
vdis = VectorDisplay(Anchor=python_2.pts, Vector=python_2.mesh_norms)
mesh_2 = Mesh(python_2.tiles)
pln = Plane(python_2.planes)

# ----
# pattern A
python_3 = PythonScript(mesh=mesh, w_tile=tile_width, l_tile=tile_length, t_tile=tile_thickness, toler_tile=tolerance, rot_angle=tile_rotation)  # -> out, contour_crvs, bottom_face, port, sequence, mesh_norms, planes, tiles; inputs mesh: Mesh
# ---------- python_3: Python ----------
import Rhino.Geometry as rg
import math

# gets Mid Point of a Curve
#************************************************
# Function    :     getmidpt
# Programmer  :     Ioannis Mirtsopoulos
# Date        :     2016.06.27
# ***********************************************

def getmidpt(crv):
    ptstart = crv.PointAtStart
    ptend = crv.PointAtEnd
    return rg.Point3d((ptstart[0] + ptend[0])/2, (ptstart[1] + ptend[1])/2, (ptstart[2] + ptend[2])/2)

# moves a line from its mid pt to a new one
#************************************************
# Function    :     moveline
# Programmer  :     Ioannis Mirtsopoulos
# Date        :     2016.06.30
# ***********************************************

def moveline(line, endmidpt):
    line = line.ToNurbsCurve()
    vec_trans = rg.Vector3d(endmidpt - getmidpt(line))
    line.Translate(vec_trans)
    return line

# deconstructs the bounding box of a mesh
#************************************************
# Function    :     deconbbox
# Programmer  :     Ioannis Mirtsopoulos
# Date        :     2016.06.27
# ***********************************************

def deconbbox(mesh):
    # create the bounding box of the mesh
    bbox = mesh.GetBoundingBox(rg.Plane.WorldXY)
    
    # extract the edges of the bounding box
    bboxedges = bbox.GetEdges()
    
    # get the lengths
    bbox_x = bboxedges[0]
    bbox_xlength = bbox_x.Length
    bbox_y = bboxedges[1]
    bbox_ylength = bbox_y.Length
    bbox_z = bboxedges[8]
    bbox_zlength = bbox_z.Length
    
    # get the leftest point of the bounding box // considered to be its starting point
    bbox_start = bbox_x.PointAt(0)
    
    # extract the edge corners
    bbox_edges = bbox.GetCorners()
    
    # get the bottom face of the bounding box
    bbox_bottom = rg.Brep.CreateFromCornerPoints(bbox_edges[0], bbox_edges[1], bbox_edges[2], bbox_edges[3], 0.01)
    
    # define the longest edge as the barrel's direction
    if bbox_xlength >= bbox_ylength: line_dir = bbox_x
    else: line_dir = bbox_y
    
    # create a vector for the long edge direction
    start = line_dir.PointAt(0)
    end = line_dir.PointAt(1)
    vec_dir = rg.Vector3d(end-start)
    vec_dir.Unitize()
    
    # create the diagonal of the bounding box
    diagon = rg.Line(bbox_x.PointAt(0), bbox_y.PointAt(1))
    diagonal = rg.LineCurve(diagon) # only created to get the mid point
    vec_diagon = rg.Vector3d(diagon.PointAt(1) - diagon.PointAt(0))
    vec_diagon.Unitize()
    
    # get the center of the base face
    center = getmidpt(diagonal)
    
    #rotate the longest edge around the center of the bounding box and parallelize it to the longest edge
    angle = rg.Vector3d.VectorAngle(vec_dir, vec_diagon)
    diagonal.Rotate(-angle, rg.Vector3d.ZAxis, center)
    mid_line = diagonal
    
    # 0 returns x edge as line
    # 1 returns y edge as line
    # 2 returns z edge as line
    # 3 returns x edge's length
    # 4 returns y edge's length
    # 5 returns z edge's length
    # 6 returns the longest edge of the bounding box
    # 7 returns the longest's edge direction as a unitized vector
    # 8 returns the diagonal on the WorldXY as a line
    # 9 returns the mid point of the above defined diagonal (center)
    # 10 returns the diagon's edge direction as a unitized vector
    # 11 returns the longest edge as curve passing through the area's center (mid_line)
    # 12 returns the starting box of the bounding box (the leftest point)
    # 13 returns the bottom face of the bounding box
    return bbox_x, bbox_y, bbox_z, bbox_xlength, bbox_ylength, bbox_zlength, line_dir, vec_dir, diagon, center, vec_diagon, mid_line, bbox_start, bbox_bottom

# shift list
#************************************************
# Function    :     shiftlist
# Programmer  :     Ioannis Mirtsopoulos
# Date        :     2016.06.27
# ***********************************************

def shift(list, k, direction):
    if direction == "right":
        k = len(list) - k
    right = list[k:]
    left = list[:k]
    return right + left

# extends a curve both sides by a length
#************************************************
# Function    :     extendcrv
# Programmer  :     Ioannis Mirtsopoulos
# Date        :     2016.06.30
# ***********************************************

def extendcrvboth(curve, length):
    new_curve = curve.Extend(rg.CurveEnd.Both, length, rg.CurveExtensionStyle.Line)
    return new_curve

# splits a curve in two
#************************************************
# Function    :     splitcrvin2
# Programmer  :     Ioannis Mirtsopoulos
# Date        :     2016.06.30
# ***********************************************

def splitcrvin2(curve):
    split_curve_array = curve.Split((curve.LengthParameter(curve.GetLength()/2))[1])
    return split_curve_array

#################################################
#################################################
################### S T A R T ###################
#################################################
#################################################


# get the longest edge of the bounding box, passing throught the area's center
direction = deconbbox(mesh)[11]
direction.Rotate(math.radians(rot_angle), rg.Vector3d.ZAxis, deconbbox(mesh)[9])

# divide the curve and get the params to evaluate
contour_params = direction.DivideByLength((w_tile + toler_tile)/2, False)
contour_params = contour_params[1::2]

contour_pts = []
perp_frames = []

# create the points of the subdivision on the diagonal and perpendicular frames on them
for param in contour_params:
    contour_pts.append(direction.PointAt(param))
    plane = rg.Plane(direction.PointAt(param), rg.Vector3d(direction.PointAt(1) - direction.PointAt(0)))
    #plane.Rotate(math.radians(rot_angle), plane.YAxis, direction.PointAt(param))
    perp_frames.append(plane)

contour_crvs = []

# create the contour curves
for frame in perp_frames:
    curve = rg.Mesh.CreateContourCurves(mesh, frame)
    
    # DivideByLength starts the division from the end of the curve
    # so I reverse the curve!!!! (optional...)
    if len(curve) > 0:
        curve[0].Reverse()
        contour_crvs.append(curve[0])

#############################################################
# VERY IMPORTANT in order to get the normals of the mesh
# otherwise i will always be getting vertical vectors (0,0,1)
#############################################################
mesh.Normals.ComputeNormals()

sequence = []
mesh_norms = []
planes = []
tiles = []
bottom_face = deconbbox(mesh)[13]

for crv in contour_crvs:
    # extend the curves both sides
    crv_ext = extendcrvboth(crv, (l_tile + toler_tile) / 2)
    
    # split the curve in two equal lengths
    crv_split = splitcrvin2(crv_ext)
    split_1 = crv_split[0]
    split_1.Reverse()     # DivideByLength starts the division from the end of the curve, so I reverse the curve!!!!
    split_2 = crv_split[1]
    
    # get the highest point of the contour curve
    top_pt = split_1.PointAtNormalizedLength(0)
    top_pt_param = 0 
    
    # divide each split segment
    tiles_params_A = split_1.DivideByLength((l_tile + toler_tile)/2, False)
    tiles_params_B = split_2.DivideByLength((l_tile + toler_tile)/2, False)
    
    pts_A = []
    tangents_A = []
    for param in tiles_params_A:
        # add a point at the params
        pt = split_1.PointAt(param)
        # add the points in an array
        pts_A.append(pt)
        tangent_param = split_1.TangentAt(param)
        tangents_A.append(tangent_param)
    pts_A = pts_A[1::2]
    pts_A.reverse()
    tangents_A = tangents_A[1::2]
    tangents_A.reverse()
    
    pts_B = []
    tangents_B = []
    for param in tiles_params_B:
        # add a point at the params
        pt = split_2.PointAt(param)
        # add the points in an array
        pts_B.append(pt)
        tangent_param = split_2.TangentAt(param)
        tangents_B.append(tangent_param)
    pts_B = pts_B[1::2]
    pts_B.reverse()
    tangents_B = tangents_B[1::2]
    tangents_B.reverse()

    if len(pts_A) > 0:
        for i in range(len(pts_A)):
            sequence.append(pts_A[i])
            sequence.append(pts_B[i])
            
            # VERY IMPORTANT // find the 3d point's closest mesh point
            mesh_pt_A = mesh.ClosestMeshPoint(pts_A[i], 0)
            mesh_pt_B = mesh.ClosestMeshPoint(pts_B[i], 0)
            
                        
            # store the Mesh point generated before in a mesh
            norm_A = mesh.NormalAt(mesh_pt_A)
            norm_B = mesh.NormalAt(mesh_pt_B)
            mesh_norms.append(norm_A)
            mesh_norms.append(norm_B)
            
            # define a plane (in-between layer of the tiles)
            cp_A = rg.Plane(pts_A[i], norm_A, tangents_A[i])
            cp_B = rg.Plane(pts_B[i], norm_B, tangents_B[i])
            cp_A.Rotate(math.radians(90), cp_A.YAxis, pts_A[i])
            cp_B.Rotate(math.radians(90), cp_B.YAxis, pts_B[i])
            planes.append(cp_A)
            planes.append(cp_B)
            
            # generate a tile
            tile_A = rg.Box(cp_A, rg.Interval(-w_tile/2, w_tile/2),rg.Interval(-l_tile/2, l_tile/2),rg.Interval(-t_tile/2, t_tile/2))
            tile_B = rg.Box(cp_B, rg.Interval(-w_tile/2, w_tile/2),rg.Interval(-l_tile/2, l_tile/2),rg.Interval(-t_tile/2, t_tile/2))
            tiles.append(tile_A)
            tiles.append(tile_B)
    
    sequence.append(top_pt)
    # VERY IMPORTANT // find the 3d point's closest mesh point
    mesh_pt = mesh.ClosestMeshPoint(top_pt, 0)
    # store the Mesh point generated before in a mesh
    norm = mesh.NormalAt(mesh_pt)
    mesh_norms.append(norm)
    # define a plane (in-between layer of the tiles)
    tangent = crv.TangentAt(0.5)
    cp = rg.Plane(top_pt, norm, tangent)
    cp.Rotate(math.radians(90), cp.YAxis, top_pt)
    planes.append(cp)
    # generate a tile
    tile = rg.Box(cp, rg.Interval(-w_tile/2, w_tile/2),rg.Interval(-l_tile/2, l_tile/2),rg.Interval(-t_tile/2, t_tile/2))
    tiles.append(tile)
# ---------- end python_3 ----------
crv_3 = Curve(python_3.contour_crvs)
srf_3 = Surface(python_3.bottom_face)
vdis_2 = VectorDisplay(Anchor=python_3.sequence, Vector=python_3.mesh_norms)
mesh_3 = Mesh(python_3.tiles)
pln_2 = Plane(python_3.planes)
